# Grasshopper definition Hive_01_Shoebox.gh (Grasshopper 1.0.7)
# plug-ins: HiveGUI

# ---- group: Zones
# Building
# Geometry
brep = Brep(<brep referenced from the Rhino model>)

# ---- group: PVST
# Energy System
# Geometry
srf = Surface([<surface referenced from the Rhino model> x2])

# ---- group: GroundCollector
srf_2 = Surface(<surface referenced from the Rhino model>)

# ---- group: Windows
srf_3 = Surface([<surface referenced from the Rhino model> x4])

# ---- group: Door
srf_4 = Surface(<surface referenced from the Rhino model>)

# ---- group: PV
srf_5 = Surface([<surface referenced from the Rhino model> x2])

# ---- group: ST
srf_6 = Surface([<surface referenced from the Rhino model> x2])

# ----
hivegui = HiveGUI(In1=[srf_4, brep, srf_3, srf_5, srf_6, srf, srf_2])  # -> Out1, Out2, Out3
