# Grasshopper definition Hive_SolarPotentialsUnobstructed.gh (Grasshopper 1.0.7)
# plug-ins: Hive.Core.solar, GHSolar, Hive.Core.epw_reader

# ---- group: Path to weather file (.epw)
# Instructions: Add the weather file path (on your laptop) in this yellow panel.
panel = Panel("C:\Users\HIVE_Zurich.epw")

# ---- group: surface orientation
number_slider = Slider(33.169, range=0..90)
number_slider_2 = Slider(108.001, range=0..360)

# ---- group: Sky view factor
toggle = BooleanToggle(True)
number_slider_3 = Slider(2, range=0..5)
number_slider_4 = Slider(0.25, range=0..1)

# ---- group: Sky view factor / Context (City, obstacles, etc.)
mesh = Mesh([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])

# ---- group: Sky view factor / analysis point
pt = Point(Point(21.71647424, -7.258711689, 0))

# ----
# Sunpath and unobstructred surface insolation
epw_reader = EPWReader(Path=panel)  # -> Latitude, Longitude, CityCountry, GHI, DNI, DHI, DryBulb, DewPoint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
simplepanel = SimplePanel(
    Tilt=number_slider,
    Azimuth=number_slider_2,
    DHI=epw_reader.DHI,
    DNI=epw_reader.DNI,
    Latitude=epw_reader.Latitude,
    Longitude=epw_reader.Longitude,
    Timezone=epw_reader.Timezone)
skydome = GHSkydome(
    RecursionLevel=number_slider_3,
    Viewfactors=toggle,
    SolarVec=False,
    HOY=0,
    Location=[epw_reader.Longitude, epw_reader.Latitude],
    DNI=epw_reader.DNI,
    DHI=epw_reader.DHI,
    Size=number_slider_4,
    Context=mesh,
    Sp=pt,
    Timezone=epw_reader.Timezone)  # -> Mesh, Vectors, Sunpaths, SunGeo
crv = Curve(skydome.Sunpaths)
graph = QuickGraph(simplepanel, SortOrder=0)
raw_data = Panel(simplepanel)
