# Grasshopper definition Hive_Form_Building_Test.gh (Grasshopper 1.0.7)
# plug-ins: HiveIO, sia380Parameters, sia380

list = ValueList({"1.2 Wohnen Einfamilienhaus"}, selected="1.2 Wohnen Einfamilienhaus")
number_slider = Slider(0.25, range=0..1)
rooms_existing = RoomsExisting({"1.1 Wohnen Mehrfamilienhaus": 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, "1.2 Wohnen Einfamilienhaus": {"description": "1.2 Wohnen Einfamilienhaus", "Raumlufttemperatur Auslegung Heizen (Winter)": 21.0, "Nettogeschossflaeche": 20.0, "Thermische Gebaeudehuellflaeche": 38.0, "U-Wert Fenster": 1.5, "Waermeeintragsleistung Personen (bei 24.0 deg C, bzw. 70 W)": 1.3999999999999999, "Jaehrliche Vollaststunden der Geraete": 1780.0, "U-Wert opake Bauteile": 0.80000000000000004, "Jaehrliche Vollaststunden der Raumbeleuchtung": 1450.0, "Vollaststunden pro Jahr (Personen)": 4090.0, "Abminderungsfaktor fuer Fensterrahmen": 0.75, "Aussenluft-Volumenstrom durch Infiltration": 0.29999999999999999, "Raumlufttemperatur Auslegung Kuehlung (Sommer)": 26.0, "Glasanteil": 30.0, "Zeitkonstante": 56.0, "Waermeeintragsleistung der Raumbeleuchtung": 2.7000000000000002, "Waermeeintragsleistung der Geraete": 10.0, "Gesamtenergiedurchlassgrad Verglasung": 0.65000000000000002, "Temperatur-Aenderungsgrad der Waermerueckgewinnung": NaN, "Aussenluft-Volumenstrom (pro NGF)": 0.59999999999999998}, "2.1 Hotelzimmer": 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, "2.2 Empfang, Lobby": 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, "3.1 Einzel-, Gruppenbuero": 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, "3.2 Grossraumbuero": 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, "3.3 Sitzungszimmer": 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, "3.4 Schalterhalle, Empfang": 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, "4.1 Schulzimmer": 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, "4.2 Lehrerzimmer": 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}, selected="1.2 Wohnen Einfamilienhaus")
sia2024roomcreator = SIA2024RoomCreator(
    Description=list,
    Room_constant=Slider(50, range=50..300),
    Cooling_setpoint=Slider(16, range=16..30),
    Heating_setpoint=Slider(16, range=16..30),
    Floor_area=number_slider,
    Envelope_area=number_slider,
    Glazing_ratio=number_slider,
    U_value_opaque=number_slider,
    U_value_transparent=number_slider,
    G_value=number_slider,
    Windows_frame_reduction=number_slider,
    Air_change_rate=number_slider,
    Infiltration=number_slider,
    Heat_recovery=number_slider,
    Occupant_loads=number_slider,
    Lighting_loads=number_slider,
    Equipment_loads=number_slider,
    Occupant_yearly_hours=number_slider,
    Lighting_yearly_hours=number_slider,
    Equipment_yearly_hours=number_slider,
    Opaque_cost=number_slider,
    Transparent_cost=number_slider,
    Opaque_emissions=number_slider,
    Transparent_emissions=number_slider)
srf = Surface([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])
brep = Brep(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)
hive_io_bldg = HiveIOBuilding(ZoneBrepGeometries=brep, WindowsSurfaces=srf, SIA2024Room_2=sia2024roomcreator)
panel = Panel(hive_io_bldg)
