# Grasshopper definition Hive_Form_PV.gh (Grasshopper 1.0.7)
# plug-ins: HiveIO

mesh = Mesh(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)
hiveiosolar = HiveIOSolarTech(Mesh=mesh)
panel = Panel(hiveiosolar)
hiveiodistr = HiveIODistributor(HiveInputObjects=hiveiosolar)  # -> HiveIOBuilding, HiveIOEnergySystemPV, HiveIOEnergySystemST, HiveIOEnergySystemPVT, HiveIOEnvironment
