# Grasshopper definition Hive_Parametric_Inputs.gh (Grasshopper 1.0.7)
# plug-ins: HiveIO, sia380Parameters

# ----
# Building
number_slider = Slider(16, range=16..30)
list = ValueList({"1.2 Wohnen Einfamilienhaus"}, selected="1.2 Wohnen Einfamilienhaus")
number_slider_2 = Slider(0.25, range=0..1)
rooms_existing = RoomsExisting({"1.1 Wohnen Mehrfamilienhaus": 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, "1.2 Wohnen Einfamilienhaus": {"description": "1.2 Wohnen Einfamilienhaus", "Raumlufttemperatur Auslegung Heizen (Winter)": 21.0, "Nettogeschossflaeche": 20.0, "Thermische Gebaeudehuellflaeche": 38.0, "U-Wert Fenster": 1.5, "Waermeeintragsleistung Personen (bei 24.0 deg C, bzw. 70 W)": 1.3999999999999999, "Jaehrliche Vollaststunden der Geraete": 1780.0, "U-Wert opake Bauteile": 0.80000000000000004, "Jaehrliche Vollaststunden der Raumbeleuchtung": 1450.0, "Vollaststunden pro Jahr (Personen)": 4090.0, "Abminderungsfaktor fuer Fensterrahmen": 0.75, "Aussenluft-Volumenstrom durch Infiltration": 0.29999999999999999, "Raumlufttemperatur Auslegung Kuehlung (Sommer)": 26.0, "Glasanteil": 30.0, "Zeitkonstante": 56.0, "Waermeeintragsleistung der Raumbeleuchtung": 2.7000000000000002, "Waermeeintragsleistung der Geraete": 10.0, "Gesamtenergiedurchlassgrad Verglasung": 0.65000000000000002, "Temperatur-Aenderungsgrad der Waermerueckgewinnung": NaN, "Aussenluft-Volumenstrom (pro NGF)": 0.59999999999999998}, "2.1 Hotelzimmer": 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, "2.2 Empfang, Lobby": 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, "3.1 Einzel-, Gruppenbuero": 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, "3.2 Grossraumbuero": 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, "3.3 Sitzungszimmer": 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, "3.4 Schalterhalle, Empfang": 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, "4.1 Schulzimmer": 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, "4.2 Lehrerzimmer": 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}, selected="1.2 Wohnen Einfamilienhaus")
srf = Surface([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])
brep = Brep(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)
nickname = GhParametricInputSIARoom(
    Descriptiont=list,
    RoomConstant=Slider(50, range=50..300),
    CoolingSetpoint=Slider(16, range=16..30),
    HeatingSetpoint=number_slider,
    FloorArea=number_slider_2,
    EnvelopeArea=number_slider_2,
    GlazingRatio=number_slider_2,
    UValueOpaque=number_slider_2,
    UValueTransparent=number_slider_2,
    GValue=number_slider_2,
    WindowFrameReduction=number_slider_2,
    AirChangeRate=number_slider_2,
    Infiltration=number_slider_2,
    HeatRecovery=number_slider_2,
    OccupantLoads=number_slider_2,
    LightingLoads=number_slider_2,
    EquipmentLoads=number_slider_2,
    OccupantYearlyHours=number_slider_2,
    LightingYearlyHours=number_slider_2,
    EquipmentYearlyHours=number_slider_2,
    OpaqueCost=number_slider_2,
    TransparentCost=number_slider_2,
    OpaqueEmissions=number_slider_2,
    TransparentEmissions=number_slider_2)
panel = Panel(nickname)
hive_io_bldg = HiveIOBuilding(ZoneBrepGeometries=brep, WindowsSurfaces=srf, SIA2024Room=nickname)
panel_2 = Panel(hive_io_bldg)

# ----
# Environment
panel_3 = Panel("UCT-Mix")
python = GhPythonScript()  # -> out, a
# ---------- python: Python ----------
__author__ = "chwaibel"
__version__ = "2020.08.19"

import rhinoscriptsyntax as rs

a = [0.1] * 8760
# ---------- end python ----------
panel_4 = Panel("C:\Users\chwaibel\Documents\GitHub\hive\GrasshopperExamples\LectureExercises\HIVE_Zurich.epw")
hiveparainpotentials = ParametricInputEnergyPotantialsHive(
    NaturalGasName="gazprom",
    NaturalGasPrice=python.a,
    NaturalGasEmissions=python.a,
    NaturalGasAvailability=python.a,
    BioGasName="Altstetten-Biogas",
    BioGasPrice=python.a,
    BioGasEmissions=python.a,
    BioGasAvailability=python.a,
    WoodPelletsName="ZuriWald",
    WoodPelletsPrice=python.a,
    WoodPelletsEmissions=python.a,
    WoodPelletsAvailability=python.a,
    DistrictHeatingName="Schwamendingen",
    DistrictHeatingPrice=python.a,
    DistrictHeatingEmissions=python.a,
    DistrictHeatingAvailability=python.a,
    DistrictHeatingSupplyTemp=python.a,
    DistrictCoolingName="Zurilake",
    DistrictCoolingPrice=python.a,
    DistrictCoolingEmissions=python.a,
    DistrictCoolingAvailability=python.a,
    DistrictCoolingSupplyTemp=python.a,
    GridElectricityName=panel_3,
    GridElectricityPrice=python.a,
    GridElectricityEmissions=python.a,
    GridElectricityAvailability=python.a)
panel_5 = Panel(hiveparainpotentials)
hiveinputenvironment = InputEnvironmentHive(EPWPath=panel_4, Potentials=hiveparainpotentials)

# ---- group: this solar tech needs to be defined in the Form!
mesh = Mesh(graft(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))

# ----
# EnergySystems
number_slider_3 = Slider(23.178, range=0..100)
number_slider_4 = Slider(0.25, range=0..100)
number_slider_5 = Slider(0.25, range=0..100)
number_slider_6 = Slider(0, range=0..100)
number_slider_7 = Slider(22.871, range=0..100)
number_slider_8 = Slider(0.25, range=0..100)
mesh_2 = Mesh(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)
mesh_3 = Mesh(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)
nickname_2 = GhParametricInputEnergySystems(
    ASHPCapacity=number_slider_8,
    ASHPCost=number_slider_8,
    ASHPEmissions=number_slider_8,
    ASHPCOP=number_slider_8,
    NGBoilerCapacity=number_slider_6,
    NGBoilerCost=number_slider_6,
    NGBoilerEmissions=number_slider_6,
    NGBoilerEfficiency=number_slider_6,
    CHPCapacity=number_slider_7,
    CHPCost=number_slider_7,
    CHPEmissions=number_slider_7,
    CHPHTP=number_slider_7,
    CHPEffElec=number_slider_7,
    ChillerCapacity=number_slider_3,
    ChillerCost=number_slider_3,
    ChillerEmissions=number_slider_3,
    ChillerCOP=number_slider_3,
    HeatExchangerCapacity=number_slider_5,
    HeatExchangerCost=number_slider_5,
    HeatExchangerEmissions=number_slider_5,
    HeatExchangerLosses=number_slider_5,
    CoolExchangerCapacity=number_slider_4,
    CoolExchangerCost=number_slider_4,
    CoolExchangerEmissions=number_slider_4,
    CoolExchangerLosses=number_slider_4)
emitterinputs = HiveIOEnergySystemsEmitter(
    Vorlauf="65",
    Rücklauf="55",
    Capacity="1.0",
    InvestmentCost="200",
    EmbodiedEmissions="50",
    Name="Heater",
    AirEmitter=False,
    Cooling=False)
emitterinputs_2 = HiveIOEnergySystemsEmitter(
    Vorlauf="20",
    Rücklauf="25",
    Capacity="1.0",
    InvestmentCost="200",
    EmbodiedEmissions="50",
    Name="Cooler",
    AirEmitter="true",
    Cooling="true")
hiveparainsolartech = ParametricInputSolarTechHive(
    Mesh=mesh_3,
    Type="PV",
    Technology="A/S wow tech",
    EfficiencyElectric="0.3",
    EfficiencyThermal="0.0",
    InvestmentCost="3000",
    EmbodiedEmissions="200")
panel_6 = Panel(hiveparainsolartech)
panel_7 = Panel(emitterinputs)
panel_8 = Panel(mesh)
panel_9 = Panel(emitterinputs_2)
panel_10 = Panel(nickname_2)

hiveparainsolartech_2 = ParametricInputSolarTechHive(
    Mesh=mesh_2,
    Type="ST",
    Technology="NanoBorgTech",
    EfficiencyElectric="0.0",
    EfficiencyThermal="0.2",
    InvestmentCost="2500",
    EmbodiedEmissions="150")

panel_11 = Panel(hiveparainsolartech_2)
hiveinputenergysystems = InputEnergySystemsHive(SolarTechProperties=[mesh, hiveparainsolartech_2, hiveparainsolartech])
panel_12 = Panel(hiveinputenergysystems)
python_2 = GhPythonScript(x=hiveinputenergysystems)  # -> out, a; inputs x: list
# ---------- python_2: Python ----------
__author__ = "chwaibel"
__version__ = "2020.08.11"

import rhinoscriptsyntax as rs

for tech in x:
    print(type(tech))
    print("Name: ", tech.Name)
    print("Capacity: ", tech.Capacity)
    print("CapacityUnit: ", tech.CapacityUnit)
# ---------- end python_2 ----------
python_3 = GhPythonScript(x=hiveinputenergysystems)  # -> out, a
# ---------- python_3: Python ----------
__author__ = "chwaibel"
__version__ = "2020.08.11"

import rhinoscriptsyntax as rs

a= x.SpecificInvestmentCost
# ---------- end python_3 ----------
panel_13 = Panel(python_3.a)

python_4 = GhPythonScript(tech=hiveinputenergysystems)  # -> out, a
# ---------- python_4: Python ----------
__author__ = "chwaibel"
__version__ = "2020.08.11"

import rhinoscriptsyntax as rs
import Hive.IO.EnergySystems as hive

print(type(tech))
print("Name: ", tech.Name)
print("Capacity: ", tech.Capacity)
print("CapacityUnit: ", tech.CapacityUnit)
if type(tech)==hive.Photovoltaic:
    print("Efficiency: ", tech.RefEfficiencyElectric)
    print("area: ", tech.SurfaceArea)
if type(tech) == hive.SolarThermal:
    print("Efficiency: ", tech.RefEfficiencyHeating)
if type(tech) == hive.GasBoiler:
    print("Efficiency: ", tech.Efficiency)

print("spec cost: ", tech.SpecificInvestmentCost)
print("tot COst: ", tech.SpecificInvestmentCost * tech.Capacity)
# ---------- end python_4 ----------

panel_14 = Panel(python_4.out)
