# Grasshopper definition Hive_Form_Building_GeometryIsValid.gh (Grasshopper 1.0.7)
# plug-ins: HiveIO

# ---- group: IsValid
brep = Brep(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)

# ---- group: non-convex
brep_2 = Brep(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)
brep_3 = Brep(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)

# ---- group: non-linear
brep_4 = Brep(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)

# ---- group: open
brep_5 = Brep(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)

# ----
hive_io_building = HiveIOBuilding(ZoneGeometry=brep)  # -> Conxex, Linear, Closed, Valid
panel = Panel([hive_io_building.Conxex, hive_io_building.Linear, hive_io_building.Closed, hive_io_building.Valid])
