# Grasshopper definition Hive_Form_PV.gh (Grasshopper 1.0.7)
# plug-ins: HiveIO

mesh = Mesh(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)
io_pv = HiveIOPV(Mesh=mesh)
panel = Panel(io_pv)
distributor = Distributor(HiveInputObjects=io_pv)  # -> IOBuilding, IOEnergySystemPV, IOEnergySystemST, IOEnergySystemPVT
