# Grasshopper definition simple_panel.gh (Grasshopper 1.0.7)
# plug-ins: solar, GHSolar

number_slider = Slider(1.295, range=-180..180)
number_slider_2 = Slider(31.832, range=-90..90)
python = GhPythonScript()  # -> out, a
# ---------- python: Python ----------
__author__ = "Christoph"
__version__ = "2020.10.12"

import rhinoscriptsyntax as rs
a = [1] * 8760
# ---------- end python ----------
panel = Panel([number_slider, number_slider_2])
simplepanel = SimplePanel(
    Tilt=Slider(90, range=0..90),
    Azimuth=Slider(180, range=0..360),
    DHI=python.a,
    DNI=python.a,
    Latitude=number_slider_2,
    Longitude=number_slider)
skydome = GHSkydome(
    RecursionLevel=0,
    SunPath=True,
    SolarVec=False,
    HOY=0,
    Location=panel,
    DNI=python.a,
    DHI=python.a,
    Sp=Point(0, 0, 0),
    Timezone=0)  # -> Mesh, Vectors, Sunpaths, SunGeo
crv = Curve(skydome.Sunpaths)
graph = QuickGraph(simplepanel, SortOrder=0)
